# Grasshopper definition test.gh (Grasshopper 1.0.7)
# plug-ins: Volvox, Kangaroo2 Components, Pancake, Pufferfish, Tarsier

downward_extension = Panel("-20")
top_shift_downwards = Panel("20")
which_part_of_the_sliced_surface = Slider(1, range=0..10)
which_part_of_the_sliced_object = Slider(3, range=0..10)
face_count_about_200 = Slider(200, range=0..1000)
accuracy_about_10 = Slider(10, range=0..10)
_2d_boundary_curve = Curve(<curve referenced from the Rhino model>)
point_cloud = Cloud(<cloud referenced from the Rhino model>)

# ---- group: Point Cloud Reduction
decloud = DeconstructCloud(Cloud=point_cloud)  # -> Points, Normals, Colors
bbox = BoundingBox(Content=point_cloud, Plane=PlaneXY(0, 0, 0))  # -> Box, Box_2
pt = Point(decloud.Points)
brepinc = PointInBrep(Brep=bbox.Box, Point=pt, Strict=False)
dispatch = Dispatch(List=pt, DispatchPattern=brepinc)  # -> ListA, ListB
pt_2 = Point(dispatch.ListA)
construct = ConstructPointCloud(Points=pt_2)
voxellize = VoxellizePointCloud(
    PointCloud=construct,
    BoundingBox=bbox.Box,
    CellSize=Slider(4, range=0..100),
    DecayRate=0,
    MaximumValue=Slider(200, range=0..1000),
    LowerThreshold=Slider(12, range=0..50))  # -> PointCloud, BoundingBox, VoxelData
deconstruct = DeconstructPointCloud(PointCloud=voxellize.PointCloud)  # -> Points, Colours, Normals

# ---- group: Boundary volume design
pdecon = Deconstruct(Point=deconstruct.Points)  # -> XComponent, YComponent, ZComponent
movetoplane = MoveToPlane(Geometry=deconstruct.Points, Plane=PlaneXY(0, 0, 0), Above=True, Below=True)  # -> Geometry, Transform
hilonums = HighestLowestNumbers(Numbers=pdecon.ZComponent)  # -> Highest, Lowest
patch = Patch(Curves=_2d_boundary_curve, Spans=20, Flexibility=1, Trim=True)
subtraction = Subtraction(A=hilonums.Highest, B=top_shift_downwards)
subtraction_2 = Subtraction(A=hilonums.Lowest, B=hilonums.Highest)
srf = Surface(patch)
addition = Addition(A=subtraction_2, B=downward_extension)
vec = VectorXYZ(XComponent=0, YComponent=0, ZComponent=subtraction)  # -> Vector, Length
move = Move(Geometry=srf, Motion=vec.Vector)  # -> Geometry, Transform
vec_2 = VectorXYZ(XComponent=0, YComponent=0, ZComponent=addition)  # -> Vector, Length
extr = Extrude(Base=move.Geometry, Direction=vec_2.Vector)
move_2 = Move(Geometry=extr, Motion=Vector(0, 0, 10))  # -> Geometry, Transform
mesh = Mesh(move_2.Geometry)

# ---- group: Rebuilding the Delauny Triangulation with adjusted parameters
del = DelaunayMesh(Points=deconstruct.Points, Plane=PlaneXY(0, 0, 0))
clean = CombineClean(Meshes=del)
weld = WeldMesh(Mesh=clean, Angle=3.141592654)
redumsh = ReduceMesh(Mesh=weld, FaceCount=face_count_about_200, Accuracy=accuracy_about_10, FaceType=1, Distort="TRUE", Normalize=False)  # -> Reduced, CountDifference

# ---- group: Split designed Object with surface
msplit = MeshSplit(Mesh=mesh, Splitters=redumsh.Reduced)
item = ListItem(List=msplit, Index=which_part_of_the_sliced_object, Wrap=True)
clean_2 = CombineClean(Meshes=item)
msh2psrf = MeshToPolysurface(Mesh=clean_2, Triangles=False, FaceMerge=False)

# ---- group: Slice the surface with the designed object
mesh_2 = Mesh(mesh)
mesh_3 = Mesh(redumsh.Reduced)
msh2psrf_2 = MeshToPolysurface(Mesh=mesh_2, Triangles=False, FaceMerge=False)
msh2psrf_3 = MeshToPolysurface(Mesh=mesh_3, Triangles=False, FaceMerge=False)
splitmul = SplitBrepMultiple(Brep=msh2psrf_3, Cutters=msh2psrf_2)
item_2 = ListItem(List=splitmul, Index=which_part_of_the_sliced_surface, Wrap=True)

# ---- group: Preview of the reconstructed object
merge = Merge(Data1=msh2psrf, Data2=item_2)
join = BrepJoin(Breps=merge)  # -> Breps, Closed

# ----
brep = Brep(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)
movement_just_for_visualization = Panel("{0,-1000,0}")
movement_just_for_visualization_2 = Panel("{0,-2000,0}")
movement_just_for_visualization_3 = Panel("{0,-3000,0}")
movement_just_for_visualization_4 = Panel("{0,-6000,0}")
movement_just_for_visualization_5 = Panel("{0,-3000,0}")
movement_just_for_visualization_6 = Panel("{0,-5000,0}")
movement_just_for_visualization_7 = Panel("{0,-4000,0}")
movement_just_for_visualization_8 = Panel("{0,-3000,0}")
move_3 = Move(Geometry=join.Breps, Motion=movement_just_for_visualization_4)  # -> Geometry, Transform
move_4 = Move(Geometry=_2d_boundary_curve, Motion=movement_just_for_visualization_5)  # -> Geometry, Transform
move_5 = Move(Geometry=msh2psrf, Motion=movement_just_for_visualization_7)  # -> Geometry, Transform
move_6 = Move(Geometry=movetoplane.Geometry, Motion=movement_just_for_visualization_3)  # -> Geometry, Transform
move_7 = Move(Geometry=mesh, Motion=movement_just_for_visualization_8)  # -> Geometry, Transform
move_8 = Move(Geometry=deconstruct.Points, Motion=movement_just_for_visualization)  # -> Geometry, Transform
move_9 = Move(Geometry=item_2, Motion=movement_just_for_visualization_6)  # -> Geometry, Transform
move_10 = Move(Geometry=redumsh.Reduced, Motion=movement_just_for_visualization_2)  # -> Geometry, Transform

# ----
# Print parameters
path_resolution = Slider(1, range=0..100)
spiral_or_seam = Slider(1, range=0..1)
layer_height = Slider(5, range=0..30)
layer_width = Slider(3.5, range=0..200)

# ----
# Mesh to be printed
mesh_4 = Mesh()

# ----
# Obejct number /
# new export
export_data = Button()

speed = Slider(4500, range=0..10000)

# ----
# Export Geometry
boolean_toggle = BooleanToggle(False)
directory = GhPythonScript(Number="1")  # -> FilePath
# ---------- directory: Python ----------
from ghpythonlib.componentbase import executingcomponent as component
import Grasshopper, GhPython
import System
import Rhino
import rhinoscriptsyntax as rs

class MyComponent(component):
    
    def RunScript(self, Number):
        """Provides a scripting component.
            Inputs:
                x: The x script variable
                y: The y script variable
            Output:
                a: The a output variable"""
        
        __author__ = "lachmayer"
        __version__ = "2022.05.24"
        
        import rhinoscriptsyntax as rs
        import os
        cwd = ghenv.Component.OnPingDocument().FilePath
        laenge = len(cwd)-12
        cwd1 = ""
        for i in range(laenge):
            cwd1 = (cwd1+cwd[i])
        cwd = cwd1
        cwd = cwd + "\mesh" + Number + ".stl"
        print(cwd)
        FilePath = cwd
                
        
        # return outputs if you have them; here I try it for you:
        return FilePath
# ---------- end directory ----------
pcexportstl = ExportSTL(
    Mesh=mesh_4,
    Relocate=boolean_toggle,
    SavePath=directory,
    SaveAsBinaryFile=True,
    SaveNow=export_data,
    LastSaveLocalization="neutral,N")

# ----
# Export Print parameters
directory_2 = GhPythonScript(Number="1")  # -> FilePath
# ---------- directory_2: Python ----------
from ghpythonlib.componentbase import executingcomponent as component
import Grasshopper, GhPython
import System
import Rhino
import rhinoscriptsyntax as rs

class MyComponent(component):
    
    def RunScript(self, Number):
        """Provides a scripting component.
            Inputs:
                x: The x script variable
                y: The y script variable
            Output:
                a: The a output variable"""
                
        __author__ = "lachmayer"
        __version__ = "2022.05.24"
                
        import rhinoscriptsyntax as rs
        import os
        cwd = ghenv.Component.OnPingDocument().FilePath
        laenge = len(cwd)-12
        cwd1 = ""
        for i in range(laenge):
            cwd1 = (cwd1+cwd[i])
        cwd = cwd1
        cwd = cwd + "\parameters" + Number + ".txt"
        print(cwd)
        FilePath = cwd
                
        
        # return outputs if you have them; here I try it for you:
        return FilePath
# ---------- end directory_2 ----------
merge_2 = Merge(Data1=layer_height, Data2=layer_width, Data3=path_resolution, Data4=spiral_or_seam)
join_2 = TextJoin(Text=merge_2, Join=";")
pcexporttxt = ExportTXT(
    Content=join_2,
    FileLocation=directory_2,
    Overwrite=export_data,
    Encoding="utf-8",
    Export=export_data,
    LastSaveLocalization="neutral,N")
